# Grasshopper definition Mandelbulb-Creation.gh (Grasshopper 1.0.7)
# Copyright: Samer Rahmeh
# plug-ins: Weaverbird

number_slider = Slider(50, range=0..1000)
number_slider_2 = Slider(100, range=0..100)
sph = Sphere(Base=PlaneXY(0, 0, 0), Radius=Slider(1, range=0..10))
sdivide = DivideSurface(Surface=sph, UCount=number_slider, VCount=number_slider)  # -> flatten(Points), Normals, Parameters
c_script = CSharpScript(iter=Slider(5, range=0..10), n=Slider(6, range=0..10), res=Slider(30, range=0..100), iPoint=sdivide.Points)  # -> out, B; inputs iter: Int32, n: Double, res: Int32, iPoint: list of Point3d
# ---------- c_script: C# ----------
    List<Vector3d> vec = new List<Vector3d>();


    for (int i = 0;i < iPoint.Count;i++)
    {
      vec.Add(new Vector3d(iPoint[i].X, iPoint[i].Y, iPoint[i].Z));
    }

    List<double> r = new List<double>();
    List<Point3d> cpt = new List<Point3d>(iPoint);



    for (int i = 0;i < iter;i++)
    {
      foreach (Vector3d v in vec)
        r.Add(v.Length);

      for(int j = 0;j < vec.Count;j++)
      {
        double phi = Math.Atan2(vec[j].Y, vec[j].X);
        double theta = Math.Atan2(Math.Sqrt(vec[j].X * vec[j].X + vec[j].Y * vec[j].Y), vec[j].Z);
        double vr = Math.Pow(r[j], n);
        double vx = Math.Sin(n * theta) * Math.Cos(n * phi);
        double vy = Math.Sin(n * theta) * Math.Sin(n * phi);
        double vz = Math.Cos(n * theta);
        vec[j] = new Vector3d(vx, vy, vz) * vr + (Vector3d) cpt[j];
        cpt[j] += vec[j];
      }

    }

    B = cpt;
# ---------- end c_script ----------
addition = Addition(A=number_slider, B=1)
bbox = BoundingBox(Content=c_script.B, Plane=PlaneXY(0, 0, 0), UnionBox=True)  # -> Box, Box_2; disabled
srfgrid = SurfaceFromPoints(Points=c_script.B, UCount=addition, Interpolate=invert(False))  # disabled
wbloop = WeaverbirdsLoopSubdivision(MeshCurves=<missing>, Level=1, SmoothNakedEdges=1)
wblaplace = WeaverbirdsLaplacianSmoothing(MeshCurves=<missing>, Level=<missing>, SmoothNakedEdges=1, Thin=1)  # disabled
